vi "BPSKRx.gvi"   [LabVIEW NXG 2.1.0]
panel controls:
  "IQ rate": f64
  "carrier frequency": f64
  "gain": f64
  "active antenna": string
  "Message length": f64
  "Symbol rate": f64
  "pulse shaping filter": T1 = "none"
  "数值": f64
  "数值_2": f64
panel indicators:
  "coerced carrier frequency": f64
  "coerced gain": f64
  "coerced IQ rate": f64
  "Error": error
  "aligned bits": i16[]
  "aligned eye": cluster{"t0": f64, "dt": f64, "Y": f64[]}[]
  "spectrum": T2
types:
  T1 = enum{"none", "Raised Cosine", "Root Raised Cos", "Gaussian"}
  T2 = cluster{"f0": f64, "df": f64, "magnitude": f64[]}
uses:
  NI::USRP::niUSRP Open Rx Session.gvi
  NI::USRP::niUSRP Configure Signal.gvi
  NI::USRP::niUSRP Initiate.gvi
  NI::USRP::niUSRP Fetch Rx Data (CDB WDT).gvi
  NI::Modulation::MT Generate Filter Coefficients.gvi
  NI::Analysis::Operations::1D Convolution (CDB).gvi
  NI::Analysis::Measurement::Power Spectrum for 1 Chan.gvi
  NI::Analysis::Resampling::Decimate (single shot, DBL).gvi
  NI::Modulation::MT Format Eye Diagram (WDT).gvi
  NI::USRP::niUSRP Abort.gvi
  NI::USRP::niUSRP Close Session.gvi
diagram:
  call "niUSRP Open Rx Session.gvi"(device names="USRP_B210") -> (session handle out=w1, error out=w2)
  Property Node(instance in=w1, "niUSRP"="1", error in=w2) -> (error out=w3, instance out=w4)
  call "niUSRP Configure Signal.gvi"(active antenna=$"active antenna", session handle=w4, error in=w3, IQ rate=$"IQ rate", carrier frequency=$"carrier frequency", gain=$gain) -> (session handle out=w5, error out=w6, coerced IQ rate=w7, coerced carrier frequency=w8, coerced gain=w9)
  $"coerced IQ rate" <- w7
  call "niUSRP Initiate.gvi"(session handle=w5, error in=w6) -> (session handle out=w10, error out=w11)
  Divide(x=w7, y=$"Symbol rate") -> w12
  Multiply($"Message length", w12) -> w13
  call "niUSRP Fetch Rx Data (CDB WDT).gvi"(session handle=w10, error in=w11, number of samples=w13) -> (session handle out=w14, error out=w15, data=w16)
  Property Node(instance in=w16) -> ("Y"=w17, "dt"=w18)
  call "MT Generate Filter Coefficients.gvi"(pulse shaping filter=$"pulse shaping filter", matched samples per symbol=w12, filter parameter=0.5, error in=w15, modulation type="PSK") -> (matched filter coefficients=w19, error out=w20)
  call "1D Convolution (CDB).gvi"(x=w17, y=w19, 错误输入=w20) -> (x * y=w21, 错误输出=w22)
  Complex To Real Imaginary(x + iy=w21) -> (x=w23)
  Build Waveform Node(Y=w23, dt=w18) -> (output waveform=w24)
  call "Power Spectrum for 1 Chan.gvi"(信号=w24, 显示为dB=TRUE) -> (功率谱=w25)
  $spectrum <- w25
  $"coerced carrier frequency" <- w8
  call "Decimate (single shot, DBL).gvi"(信号=w23, 降采样因子=w12) -> (降采样信号=w26)
  call "PulseAlign.gvi"(Received Sampling Factor=w12, Input signal=w26) -> (output signal=w27)
  Complex To Real Imaginary(x + iy=w27) -> (x=w28)
  Is Greater Or Equal(x=w28, y=0) -> w29
  Boolean To Integer(Boolean=w29) -> (0, 1=w30)
  $"aligned bits" <- w30
  call "MT Format Eye Diagram (WDT).gvi"(waveform=w24, symbol rate=$"Symbol rate", eye length=2) -> (eye diagram=w31)
  $"aligned eye" <- w31
  $"coerced gain" <- w9
  call "niUSRP Abort.gvi"(session handle=w14, error in=w22) -> (session handle out=w32, error out=w33)
  call "niUSRP Close Session.gvi"(session handle=w32, error in=w33) -> (error out=w34)
  $Error <- w34
