vi "BPSKTx_shortPN.gvi"   [LabVIEW NXG 2.1.0]
panel controls:
  "IQ rate": f64
  "carrier frequency": f64
  "gain": f64
  "active antenna": string
  "Stop": bool
  "Message length": f64
  "Symbol rate": f64
  "pulse shaping filter": T1 = "none"
panel indicators:
  "coerced IQ rate": f64
  "coerced carrier frequency": f64
  "coerced gain": f64
  "Error": error
  "upsampling factor": f64
  "pulse shaping filter coefficients": f64[]
  "spectrum": T2
  "eye diagram": cluster{"t0": f64, "dt": f64, "Y": f64[]}[]
  "output bit stream": i8[]
types:
  T1 = enum{"none", "Raised Cosine", "Root Raised Cos", "Gaussian"}
  T2 = cluster{"f0": f64, "df": f64, "magnitude": f64[]}
uses:
  NI::Modulation::MT Generate Bits (User Defined).gvi
  NI::USRP::niUSRP Open Tx Session.gvi
  NI::USRP::niUSRP Configure Signal.gvi
  NI::Analysis::Resampling::Upsample (DBL).gvi
  NI::Modulation::MT Generate Filter Coefficients.gvi
  NI::Analysis::Operations::1D Convolution (DBL).gvi
  NI::USRP::niUSRP Write Tx Data (CDB).gvi
  NI::USRP::niUSRP Close Session.gvi
  NI::Modulation::MT Format Eye Diagram (WDT).gvi
  NI::Analysis::Measurement::Power Spectrum for 1 Chan.gvi
diagram:
  call "MT Generate Bits (User Defined).gvi"(total bits=$"Message length", user base bit pattern=[1, 0, 1, 1, 1, 0, 0]) -> (output bit stream=w1)
  $"output bit stream" <- w1
  call "niUSRP Open Tx Session.gvi"(device names="USRP_B210") -> (session handle out=w2, error out=w3)
  Property Node(instance in=w2, "niUSRP"="0", error in=w3) -> (error out=w4, instance out=w5)
  call "niUSRP Configure Signal.gvi"(active antenna=$"active antenna", session handle=w5, error in=w4, IQ rate=$"IQ rate", carrier frequency=$"carrier frequency", gain=$gain) -> (session handle out=w6, error out=w7, coerced IQ rate=w8, coerced carrier frequency=w9, coerced gain=w10)
  Divide(x=w8, y=$"Symbol rate") -> w11
  $"upsampling factor" <- w11
  Multiply(w1, 2) -> w12
  Decrement(x=w12) -> w13
  call "Upsample (DBL).gvi"(信号=w13, 升采样因子=w11) -> (升采样信号=w14)
  call "MT Generate Filter Coefficients.gvi"(pulse shaping filter=$"pulse shaping filter", pulse shaping samples per symbol=w11, filter parameter=0.5, modulation type="PSK") -> (pulse shaping filter coefficients=w15)
  call "1D Convolution (DBL).gvi"(x=w14, y=w15) -> (x * y=w16)
  call "norm1D.gvi"(input array=w16) -> (normalized array=w17)
  while {
    call "niUSRP Write Tx Data (CDB).gvi"(session handle=w6, error in=w7, data=w17) -> (session handle out=w18, error out=w19)
    Logical Or(w19, $Stop) -> w20
    stop if w20
  }
  call "niUSRP Close Session.gvi"(session handle=w18, error in=w19) -> (error out=w21)
  $Error <- w21
  Reciprocal(x=w8) -> w22
  Build Waveform Node(Y=w17, dt=w22) -> (output waveform=w23)
  call "MT Format Eye Diagram (WDT).gvi"(waveform=w23, symbol rate=$"Symbol rate", eye length=2) -> (eye diagram=w24)
  $"eye diagram" <- w24
  $"coerced IQ rate" <- w8
  call "Power Spectrum for 1 Chan.gvi"(信号=w23, 显示为dB=TRUE) -> (功率谱=w25)
  $spectrum <- w25
  $"coerced carrier frequency" <- w9
  $"coerced gain" <- w10
  $"pulse shaping filter coefficients" <- w15
