vi "FrameSync.gvi"   [LabVIEW NXG 2.1.0]
inputs:
  "Unsynced frame": f64[]
  "Training sequence": f64[]
  "Threshold": f64
outputs:
  "Synced frame": f64[]
  "Cross-correlation result": f64[]
  "Peak index": i32[]
uses:
  NI::Analysis::Operations::1D Cross Correlation (DBL).gvi
  NI::Analysis::Measurement::Threshold Detector (1D DBL).gvi
diagram:
  call "1D Cross Correlation (DBL).gvi"(x=$"Unsynced frame", y=$"Training sequence") -> (Rxy=w1)
  $"Cross-correlation result" <- w1
  call "Threshold Detector (1D DBL).gvi"(信号=w1, 阈值=$Threshold) -> (位置=w2)
  $"Peak index" <- w2
  Array Index(array=w2) -> (out0[0]=w3)
  Array Subset(array=$"Unsynced frame", index0=w3) -> w4
  $"Synced frame" <- w4
