vi "PulseAlign.gvi"   [LabVIEW NXG 2.1.0]
inputs:
  "Input signal": c128[]
  "Received Sampling Factor": i32
outputs:
  "Objective Function": f64[]
  "alignment offset": i32
  "output signal": c128[]
uses:
  NI::Analysis::Resampling::Decimate (single shot, CDB).gvi
diagram:
  for (N = $"Received Sampling Factor") (iteration -> i1) {
    Array Subset(array=$"Input signal", index0=i1) -> w2
    call "Decimate (single shot, CDB).gvi"(信号=w2, 降采样因子=$"Received Sampling Factor") -> (降采样信号=w3)
    Complex To Polar(r * e^(i*theta)=w3) -> (r=w4)
    Square(x=w4) -> w5
    Add Array Elements(numeric array=w5) -> (sum=w6)
    append w6 to w1
  }
  $"Objective Function" <- w1
  Array Max And Min(array=w1) -> (max index(es)=w7)
  $"alignment offset" <- w7
  Array Subset(array=$"Input signal", index0=w7) -> w8
  $"output signal" <- w8
