vi "RxBPSK.gvi"   [LabVIEW NXG 2.1.0]
panel controls:
  "IQ rate": f64
  "carrier frequency": f64
  "gain": f64
  "active antenna": string
  "Message length": f64
  "Symbol rate": f64
  "pulse shaping filter": T1 = "none"
panel indicators:
  "coerced carrier frequency": f64
  "coerced gain": f64
  "coerced IQ rate": f64
  "Error": error
  "aligned bits": i16[]
  "aligned eye": cluster{"t0": f64, "dt": f64, "Y": f64[]}[]
  "Constellation": c128[]
types:
  T1 = enum{"none", "Raised Cosine", "Root Raised Cos", "Gaussian"}
uses:
  NI::USRP::niUSRP Open Rx Session.gvi
  NI::USRP::niUSRP Configure Signal.gvi
  NI::USRP::niUSRP Initiate.gvi
  NI::USRP::niUSRP Fetch Rx Data (CDB WDT).gvi
  NI::Modulation::MT Generate Filter Coefficients.gvi
  NI::Analysis::Operations::1D Convolution (CDB).gvi
  NI::USRP::niUSRP Abort.gvi
  NI::USRP::niUSRP Close Session.gvi
  NI::Modulation::MT Format Eye Diagram (WDT).gvi
  NI::Modulation::MT Generate Bits (Fibonacci, PN Order).gvi
  NI::Analysis::Resampling::Decimate (single shot, DBL).gvi
diagram:
  call "niUSRP Open Rx Session.gvi"(device names="USRP_B210") -> (session handle out=w1, error out=w2)
  Property Node(instance in=w1, "niUSRP"="1", error in=w2) -> (error out=w3, instance out=w4)
  call "niUSRP Configure Signal.gvi"(active antenna=$"active antenna", session handle=w4, error in=w3, IQ rate=$"IQ rate", carrier frequency=$"carrier frequency", gain=$gain) -> (session handle out=w5, error out=w6, coerced IQ rate=w7, coerced carrier frequency=w8, coerced gain=w9)
  $"coerced carrier frequency" <- w8
  call "niUSRP Initiate.gvi"(session handle=w5, error in=w6) -> (session handle out=w10, error out=w11)
  Divide(x=w7, y=$"Symbol rate") -> w12
  Multiply($"Message length", w12) -> w13
  call "niUSRP Fetch Rx Data (CDB WDT).gvi"(session handle=w10, error in=w11, number of samples=w13) -> (session handle out=w14, error out=w15, data=w16)
  Property Node(instance in=w16) -> ("Y"=w17, "dt"=w18)
  call "MT Generate Filter Coefficients.gvi"(pulse shaping filter=$"pulse shaping filter", matched samples per symbol=w12, filter parameter=0.5, error in=w15, modulation type="PSK") -> (matched filter coefficients=w19, error out=w20)
  call "1D Convolution (CDB).gvi"(x=w17, y=w19, 错误输入=w20) -> (x * y=w21, 错误输出=w22)
  call "niUSRP Abort.gvi"(session handle=w14, error in=w22) -> (session handle out=w23, error out=w24)
  call "niUSRP Close Session.gvi"(session handle=w23, error in=w24) -> (error out=w25)
  $Error <- w25
  $"coerced gain" <- w9
  Complex To Real Imaginary(x + iy=w21) -> (x=w26)
  Build Waveform Node(Y=w26, dt=w18) -> (output waveform=w27)
  call "MT Format Eye Diagram (WDT).gvi"(waveform=w27, symbol rate=$"Symbol rate", eye length=2) -> (eye diagram=w28)
  $"aligned eye" <- w28
  $"coerced IQ rate" <- w7
  call "MT Generate Bits (Fibonacci, PN Order).gvi"(total bits=$"Message length", PN sequence order=5) -> (output bit stream=w29)
  Multiply(w29, 2) -> w30
  Decrement(x=w30) -> w31
  call "Decimate (single shot, DBL).gvi"(信号=w26, 降采样因子=w12) -> (降采样信号=w32)
  call "PulseAlign.gvi"(Input signal=w32, Received Sampling Factor=w12) -> (output signal=w33)
  Complex To Real Imaginary(x + iy=w33) -> (x=w34)
  Is Greater Or Equal(x=w34, y=0) -> w35
  Boolean To Integer(Boolean=w35) -> (0, 1=w36)
  s1 = 0  # shift register
  for {
    w37 = each element of w36
    w38 = each element of w31
    Is Not Equal(x=w38, y=w37) -> w39
    Boolean To Integer(Boolean=w39) -> (0, 1=w40)
    Add(w40, s1) -> w41
    next s1 = w41
  }
  Divide(x=s1, y=$"Message length") -> w42
  $"aligned bits" <- w36
  $Constellation <- w33
