vi "RxDBPSK.gvi"   [LabVIEW NXG 2.1.0]
panel controls:
  "IQ rate": f64
  "carrier frequency": f64
  "gain": f64
  "active antenna": string
  "Message length": f64
  "Symbol rate": f64
  "pulse shaping filter": T1 = "none"
  "Enabled Channels": string
  "Training sequence": f64[]
panel indicators:
  "coerced IQ rate": f64
  "coerced carrier frequency": f64
  "coerced gain": f64
  "Error": error
  "aligned bits": i16[]
  "aligned eye": cluster{"t0": f64, "dt": f64, "Y": f64[]}[]
  "Constellation": c128[]
types:
  T1 = enum{"none", "Raised Cosine", "Root Raised Cos", "Gaussian"}
uses:
  NI::USRP::niUSRP Open Rx Session.gvi
  NI::USRP::niUSRP Configure Signal.gvi
  NI::USRP::niUSRP Initiate.gvi
  NI::USRP::niUSRP Fetch Rx Data (CDB WDT).gvi
  NI::Modulation::MT Generate Filter Coefficients.gvi
  NI::Analysis::Operations::1D Convolution (CDB).gvi
  NI::Analysis::Resampling::Decimate (single shot, CDB).gvi
  NI::USRP::niUSRP Abort.gvi
  NI::USRP::niUSRP Close Session.gvi
  NI::Modulation::MT Format Eye Diagram (WDT).gvi
diagram:
  call "niUSRP Open Rx Session.gvi"(device names="USRP_B210") -> (session handle out=w1, error out=w2)
  Property Node(instance in=w1, "niUSRP"="1", error in=w2) -> (error out=w3, instance out=w4)
  call "niUSRP Configure Signal.gvi"(active antenna=$"active antenna", session handle=w4, error in=w3, IQ rate=$"IQ rate", carrier frequency=$"carrier frequency", gain=$gain) -> (session handle out=w5, error out=w6, coerced IQ rate=w7, coerced carrier frequency=w8, coerced gain=w9)
  Divide(x=w7, y=$"Symbol rate") -> w10
  Add(w7, w8) -> w11
  Property Node(instance in=w5, "niUSRP"=$"Enabled Channels", "niUSRP"=w11, error in=w6) -> (error out=w12, instance out=w13)
  call "niUSRP Initiate.gvi"(session handle=w13, error in=w12) -> (session handle out=w14, error out=w15)
  Multiply(2, $"Message length") -> w16
  Multiply(w16, w10) -> w17
  call "niUSRP Fetch Rx Data (CDB WDT).gvi"(session handle=w14, error in=w15, number of samples=w17) -> (session handle out=w18, error out=w19, data=w20)
  call "MT Generate Filter Coefficients.gvi"(pulse shaping filter=$"pulse shaping filter", matched samples per symbol=w10, error in=w19, modulation type="PSK") -> (matched filter coefficients=w21, error out=w22)
  Property Node(instance in=w20) -> ("Y"=w23, "dt"=w24)
  call "1D Convolution (CDB).gvi"(x=w23, y=w21, 错误输入=w22) -> (x * y=w25, 错误输出=w26)
  call "PulseAlign.gvi"(Input signal=w25, Received Sampling Factor=w10) -> (output signal=w27)
  call "Decimate (single shot, CDB).gvi"(信号=w27, 降采样因子=w10) -> (降采样信号=w28)
  call "norm1D_median.gvi"(Vector=w28) -> (Normalized Vector=w29)
  s1 = 1  # shift register
  for {
    w30 = each element of w29
    Complex Conjugate(x + iy=s1) -> w32
    Multiply(w30, w32) -> w33
    append w33 to w31
    next s1 = w30
  }
  $Constellation <- w31
  call "niUSRP Abort.gvi"(session handle=w18, error in=w26) -> (session handle out=w34, error out=w35)
  call "niUSRP Close Session.gvi"(session handle=w34, error in=w35) -> (error out=w36)
  $Error <- w36
  Complex To Real Imaginary(x + iy=w31) -> (x=w37)
  call "FrameSync.gvi"(Unsynced frame=w37, Training sequence=$"Training sequence", Threshold=18) -> (Synced frame=w38)
  Is Greater Or Equal(x=w38, y=0) -> w39
  Boolean To Integer(Boolean=w39) -> (0, 1=w40)
  $"aligned bits" <- w40
  $"coerced IQ rate" <- w7
  $"coerced carrier frequency" <- w8
  $"coerced gain" <- w9
  Complex To Real Imaginary(x + iy=w27) -> (x=w41)
  Build Waveform Node(Y=w41, dt=w24) -> (output waveform=w42)
  call "MT Format Eye Diagram (WDT).gvi"(waveform=w42, symbol rate=$"Symbol rate", eye length=2) -> (eye diagram=w43)
  $"aligned eye" <- w43
