vi "Sim_framesync.gvi"   [LabVIEW NXG 2.1.0]
panel indicators:
  "Original frame": f64[]
  "Frame with training sequence": f64[]
  "Synced frame": f64[]
  "Cross-correlation result": f64[]
  "Peak index": i32[]
uses:
  NI::Modulation::MT Generate Bits (Fibonacci, PN Order).gvi
diagram:
  call "MT Generate Bits (Fibonacci, PN Order).gvi"(total bits=50, PN sequence order=5) -> (output bit stream=w1)
  Multiply(w1, 2) -> w2
  Decrement(x=w2) -> w3
  $"Original frame" <- w3
  Build Array[ConcatenateInputs=True]([1, 1, 1, 1, 1, -1, -1, 1, 1, -1, 1, -1, 1], [1, 1, 1, 1, 1, -1, -1, 1, 1, -1, 1, -1, 1]) -> w4
  call "AddTraining.gvi"(Original frame=w3, Training sequence=w4) -> (Frame with training sequence=w5)
  $"Frame with training sequence" <- w5
  call "FrameSync.gvi"(Unsynced frame=w5, Training sequence=w4, Threshold=9) -> (Synced frame=w6, Cross-correlation result=w7, Peak index=w8)
  $"Synced frame" <- w6
  $"Cross-correlation result" <- w7
  $"Peak index" <- w8
