vi "TxDBPSK.gvi"   [LabVIEW NXG 2.1.0]
panel controls:
  "IQ rate": f64
  "carrier frequency": f64
  "gain": f64
  "active antenna": string
  "Stop": bool
  "Message length": f64
  "Symbol rate": f64
  "pulse shaping filter": T1 = "none"
  "Training sequence": f64[]
panel indicators:
  "coerced IQ rate": f64
  "coerced carrier frequency": f64
  "coerced gain": f64
  "Error": error
  "upsampling factor": f64
  "pulse shaping filter coefficients": f64[]
  "spectrum": T2
  "eye diagram": cluster{"t0": f64, "dt": f64, "Y": f64[]}[]
  "output bit stream": i8[]
  "bit to code": f64[]
  "code": f64[]
types:
  T1 = enum{"none", "Raised Cosine", "Root Raised Cos", "Gaussian"}
  T2 = cluster{"f0": f64, "df": f64, "magnitude": f64[]}
uses:
  NI::USRP::niUSRP Open Tx Session.gvi
  NI::USRP::niUSRP Configure Signal.gvi
  NI::Modulation::MT Generate Bits (Fibonacci, PN Order).gvi
  NI::Analysis::Resampling::Upsample (DBL).gvi
  NI::Modulation::MT Generate Filter Coefficients.gvi
  NI::Analysis::Operations::1D Convolution (DBL).gvi
  NI::USRP::niUSRP Write Tx Data (CDB).gvi
  NI::USRP::niUSRP Close Session.gvi
  NI::Modulation::MT Format Eye Diagram (WDT).gvi
  NI::Analysis::Measurement::Power Spectrum for 1 Chan.gvi
diagram:
  call "niUSRP Open Tx Session.gvi"(device names="USRP_B210") -> (session handle out=w1, error out=w2)
  Property Node(instance in=w1, "niUSRP"="0", error in=w2) -> (error out=w3, instance out=w4)
  call "niUSRP Configure Signal.gvi"(active antenna=$"active antenna", session handle=w4, error in=w3, IQ rate=$"IQ rate", carrier frequency=$"carrier frequency", gain=$gain) -> (session handle out=w5, error out=w6, coerced IQ rate=w7, coerced carrier frequency=w8, coerced gain=w9)
  $"coerced IQ rate" <- w7
  $"coerced gain" <- w9
  call "MT Generate Bits (Fibonacci, PN Order).gvi"(total bits=$"Message length", PN sequence order=5) -> (output bit stream=w10)
  $"output bit stream" <- w10
  Multiply(w10, 2) -> w11
  Decrement(x=w11) -> w12
  call "AddTraining.gvi"(Original frame=w12, Training sequence=$"Training sequence") -> (Frame with training sequence=w13)
  $"bit to code" <- w13
  s1 = 1  # shift register
  for {
    w14 = each element of w13
    Multiply(w14, s1) -> w16
    append w16 to w15
    next s1 = w16
  }
  $code <- w15
  Add(w7, w8) -> w17
  Property Node(instance in=w5, "niUSRP"="0", "niUSRP"=w17, error in=w6) -> (error out=w18, instance out=w19)
  Divide(x=w7, y=$"Symbol rate") -> w20
  call "Upsample (DBL).gvi"(信号=w15, 升采样因子=w20) -> (升采样信号=w21)
  call "MT Generate Filter Coefficients.gvi"(pulse shaping filter=$"pulse shaping filter", pulse shaping samples per symbol=w20, filter parameter=0.5, modulation type="PSK") -> (pulse shaping filter coefficients=w22)
  call "1D Convolution (DBL).gvi"(x=w21, y=w22) -> (x * y=w23)
  call "norm1D.gvi"(input array=w23) -> (normalized array=w24)
  while {
    call "niUSRP Write Tx Data (CDB).gvi"(session handle=w19, error in=w18, data=w24) -> (session handle out=w25, error out=w26)
    Logical Or(w26, $Stop) -> w27
    stop if w27
  }
  call "niUSRP Close Session.gvi"(session handle=w25, error in=w26) -> (error out=w28)
  $Error <- w28
  $"upsampling factor" <- w20
  Reciprocal(x=w7) -> w29
  Build Waveform Node(Y=w24, dt=w29) -> (output waveform=w30)
  call "MT Format Eye Diagram (WDT).gvi"(waveform=w30, symbol rate=$"Symbol rate", eye length=2) -> (eye diagram=w31)
  $"eye diagram" <- w31
  call "Power Spectrum for 1 Chan.gvi"(信号=w30, 显示为dB=TRUE) -> (功率谱=w32)
  $spectrum <- w32
  $"coerced carrier frequency" <- w8
  $"pulse shaping filter coefficients" <- w22
