vi "norm1D.gvi"   [LabVIEW NXG 2.1.0]
inputs:
  "input array": f64[]
outputs:
  "normalized array": f64[]
diagram:
  Absolute Value(x=$"input array") -> w1
  Array Max And Min(array=w1) -> (max value=w2)
  Divide(x=$"input array", y=w2) -> w3
  $"normalized array" <- w3
