vi "norm1D_median.gvi"   [LabVIEW NXG 2.1.0]
inputs:
  "Vector": c128[]
outputs:
  "Normalized Vector": c128[]
  "mean": c128
  "median": f64
uses:
  NI::Analysis::Statistics::Statistics (1D DBL).gvi
  NI::Analysis::Statistics::Mean (CDB).gvi
diagram:
  Complex To Polar(r * e^(i*theta)=$Vector) -> (r=w1)
  call "Statistics (1D DBL).gvi"(信号=w1) -> (中值=w2)
  call "Mean (CDB).gvi"(x=$Vector) -> (平均值=w3)
  Subtract(x=$Vector, y=w3) -> w4
  Divide(x=w4, y=w2) -> w5
  $"Normalized Vector" <- w5
  $mean <- w3
  $median <- w2
