vi "函数.gvi"   [LabVIEW NXG 5.0.0]
panel controls:
  "Array": f64[]
panel indicators:
  "Maximum value": f64
  "Index of max value": i32
diagram:
  Array Index(array=$Array) -> (out0[0]=w1)
  s1 = w1  # shift register
  s2 = 0  # shift register
  for (iteration -> i1) {
    w2 = each element of $Array
    Is Greater(x=w2, y=s1) -> w3
    Select(s=w3, t=w2, f=s1) -> w4
    $"Maximum value" <- w4
    Select(s=w3, t=i1, f=s2) -> w5
    $"Index of max value" <- w5
    next s1 = w4
    next s2 = w5
  }
