vi "函数.gvi"   [LabVIEW NXG 5.0.0]
panel controls:
  "Cluster": T1
  "整型控制输入": i32
panel indicators:
  "Modified String": string
  "Modified Array": f64[]
  "Modified Cluster": T1
  "双精度类型显示输出": f64
  "字符串显示输出": string
types:
  T1 = cluster{"String": string, "Offset": f64, "Array": f64[]}
diagram:
  Property Node(instance in=$Cluster) -> ("String"=w1, "Offset"=w2, "Array"=w3, instance out=w4)
  Reverse String(string=w1) -> (reversed=w5)
  $"Modified String" <- w5
  Add(w2, w3) -> w6
  Property Node(instance in=w4, "String"=w5, "Array"=w6) -> (instance out=w7)
  $"Modified Cluster" <- w7
  $"Modified Array" <- w6
  $"双精度类型显示输出" <- $"整型控制输入"
  Number To Decimal String(number=$"整型控制输入") -> (decimal integer string=w8)
  $"字符串显示输出" <- w8
