vi "函数.gvi"   [LabVIEW NXG 5.0.0]
panel indicators:
  "Number of interations": i32
  "Random number A": f64
  "Random number B": f64
  "Points A": i32
  "Points B": i32
  "Team A": bool
  "Team B": bool
uses:
  NI::G Core::Numeric::Random Number (Range) DBL.gvi
diagram:
  s1 = 0  # shift register
  s2 = 0  # shift register
  while (iteration -> i1) {
    call "Random Number (Range) DBL.gvi"(上限=0.5, 下限=-0.5) -> (数值=w1)
    call "Random Number (Range) DBL.gvi"(上限=0.5, 下限=-0.5) -> (数值=w2)
    Is Greater(x=w1, y=w2) -> w3
    Boolean To 0 Or 1(Boolean=w3) -> (0, 1=w4)
    Add(s1, w4) -> w5
    $"Points A" <- w5
    $"Random number A" <- w1
    Is Equal(x=w5, y=50) -> w6
    $"Team A" <- w6
    Not(x=w3) -> w7
    Boolean To 0 Or 1(Boolean=w7) -> (0, 1=w8)
    Add(w8, s2) -> w9
    Is Equal(x=50, y=w9) -> w10
    Logical Or(w6, w10) -> w11
    $"Team B" <- w10
    $"Random number B" <- w2
    $"Points B" <- w9
    Wait(time to wait=100)
    Add(1, i1) -> w12
    $"Number of interations" <- w12
    next s1 = w5
    next s2 = w9
    stop if w11
  }
