vi "函数.gvi"   [LabVIEW NXG 5.0.0]
panel controls:
  "Number to match": f64
  "停止": bool
panel indicators:
  "Random Integer": f64
  "布尔": bool
  "While Count": i32
diagram:
  while (iteration -> i1) {
    Random Number() -> (number (0 to 1)=w1)
    Multiply(w1, 10) -> w2
    Round To Nearest(number=w2) -> w3
    Is Less(x=5, y=w3) -> w4
    $"布尔" <- w4
    $"Random Integer" <- w3
    Is Equal(x=w3, y=$"Number to match") -> w5
    Logical Or(w5, $"停止") -> w6
    Wait(time to wait=1000)
    $"While Count" <- i1
    stop if w6
  }
