vi "Rx.gvi"   [LabVIEW NXG 2.1.0]
panel controls:
  "IQ rate": f64
  "carrier frequency": f64
  "gain": f64
  "active antenna": string
  "Number of Samples": i32
  "Stop": bool
panel indicators:
  "coerced carrier frequency": f64
  "coerced gain": f64
  "coerced IQ rate": f64
  "Error": error
  "Graph": T1
  "Q channel": waveform<f64>
  "I channel": waveform<f64>
types:
  T1 = cluster{"f0": f64, "df": f64, "magnitude": f64[]}
uses:
  NI::USRP::niUSRP Open Rx Session.gvi
  NI::USRP::niUSRP Configure Signal.gvi
  NI::USRP::niUSRP Initiate.gvi
  NI::USRP::niUSRP Fetch Rx Data (CDB WDT).gvi
  NI::Analysis::Measurement::Power Spectrum for 1 Chan (CDB).gvi
  NI::USRP::niUSRP Abort.gvi
  NI::USRP::niUSRP Close Session.gvi
diagram:
  call "niUSRP Open Rx Session.gvi"(device names="USRP_B210") -> (session handle out=w1, error out=w2)
  Property Node(instance in=w1, "niUSRP"="1", error in=w2) -> (error out=w3, instance out=w4)
  call "niUSRP Configure Signal.gvi"(active antenna=$"active antenna", session handle=w4, error in=w3, IQ rate=$"IQ rate", carrier frequency=$"carrier frequency", gain=$gain) -> (session handle out=w5, error out=w6, coerced IQ rate=w7, coerced carrier frequency=w8, coerced gain=w9)
  call "niUSRP Initiate.gvi"(session handle=w5, error in=w6) -> (session handle out=w10, error out=w11)
  while {
    call "niUSRP Fetch Rx Data (CDB WDT).gvi"(session handle=w10, error in=w11, number of samples=$"Number of Samples") -> (session handle out=w12, error out=w13, data=w14)
    Logical Or(w13, $Stop) -> w15
    Property Node(instance in=w14) -> ("Y"=w16, "dt"=w17)
    Complex To Real Imaginary(x + iy=w16) -> (x=w18, y=w19)
    Build Waveform Node(Y=w18, dt=w17) -> (output waveform=w20)
    $"Q channel" <- w20
    Build Waveform Node(Y=w19, dt=w17) -> (output waveform=w21)
    $"I channel" <- w21
    call "Power Spectrum for 1 Chan (CDB).gvi"(信号=w14, 显示为dB=TRUE) -> (功率谱=w22)
    $Graph <- w22
    stop if w15
  }
  call "niUSRP Abort.gvi"(session handle=w12, error in=w13) -> (session handle out=w23, error out=w24)
  call "niUSRP Close Session.gvi"(session handle=w23, error in=w24) -> (error out=w25)
  $Error <- w25
  $"coerced IQ rate" <- w7
  $"coerced carrier frequency" <- w8
  $"coerced gain" <- w9
