vi "carrier.gvi"   [LabVIEW NXG 2.1.0]
panel controls:
  "IQ rate": f64
  "carrier frequency": f64
  "gain": f64
  "active antenna": string
  "Stop": bool
  "waveform size": i32
panel indicators:
  "coerced IQ rate": f64
  "coerced carrier frequency": f64
  "coerced gain": f64
  "Error": error
uses:
  NI::USRP::niUSRP Open Tx Session.gvi
  NI::USRP::niUSRP Configure Signal.gvi
  NI::USRP::niUSRP Write Tx Data (CDB).gvi
  NI::USRP::niUSRP Close Session.gvi
diagram:
  call "niUSRP Open Tx Session.gvi"(device names="USRP_B210") -> (session handle out=w1, error out=w2)
  Property Node(instance in=w1, "niUSRP"="0", error in=w2) -> (error out=w3, instance out=w4)
  call "niUSRP Configure Signal.gvi"(active antenna=$"active antenna", session handle=w4, error in=w3, IQ rate=$"IQ rate", carrier frequency=$"carrier frequency", gain=$gain) -> (session handle out=w5, error out=w6, coerced IQ rate=w7, coerced carrier frequency=w8, coerced gain=w9)
  Initialize Array(element=1, size=$"waveform size") -> w10
  while {
    call "niUSRP Write Tx Data (CDB).gvi"(session handle=w5, error in=w6, data=w10) -> (session handle out=w11, error out=w12)
    Logical Or(w12, $Stop) -> w13
    stop if w13
  }
  call "niUSRP Close Session.gvi"(session handle=w11, error in=w12) -> (error out=w14)
  $Error <- w14
  $"coerced IQ rate" <- w7
  $"coerced carrier frequency" <- w8
  $"coerced gain" <- w9
