vi "double_side_IQ.gvi"   [LabVIEW NXG 2.1.0]
panel controls:
  "IQ rate": f64
  "carrier frequency": f64
  "gain": f64
  "active antenna": string
  "Stop": bool
  "tone amplitude": f64
  "tone frequency": f64
  "waveform size": i32
panel indicators:
  "coerced IQ rate": f64
  "coerced carrier frequency": f64
  "coerced gain": f64
  "Error": error
uses:
  NI::USRP::niUSRP Open Tx Session.gvi
  NI::USRP::niUSRP Configure Signal.gvi
  NI::Analysis::Generation::Sine Waveform.gvi
  NI::USRP::niUSRP Write Tx Data (CDB).gvi
  NI::USRP::niUSRP Close Session.gvi
diagram:
  call "niUSRP Open Tx Session.gvi"(device names="USRP_B210") -> (session handle out=w1, error out=w2)
  Property Node(instance in=w1, "niUSRP"="0", error in=w2) -> (error out=w3, instance out=w4)
  call "niUSRP Configure Signal.gvi"(active antenna=$"active antenna", session handle=w4, error in=w3, IQ rate=$"IQ rate", carrier frequency=$"carrier frequency", gain=$gain) -> (session handle out=w5, error out=w6, coerced IQ rate=w7, coerced carrier frequency=w8, coerced gain=w9)
  $"coerced IQ rate" <- w7
  call "Sine Waveform.gvi"(采样率=w7, 采样=$"waveform size", 幅值=$"tone amplitude", 频率=$"tone frequency") -> (正弦波=w10)
  Property Node(instance in=w10) -> ("Y"=w11)
  Real And Imaginary To Complex(x=w11, y=0) -> w12
  while {
    call "niUSRP Write Tx Data (CDB).gvi"(session handle=w5, error in=w6, data=w12) -> (session handle out=w13, error out=w14)
    Logical Or(w14, $Stop) -> w15
    stop if w15
  }
  call "niUSRP Close Session.gvi"(session handle=w13, error in=w14) -> (error out=w16)
  $Error <- w16
  call "Sine Waveform.gvi"(采样率=w7, 采样=$"waveform size", 幅值=$"tone amplitude", 频率=$"tone frequency", 相位输入=90) -> (正弦波=w17)
  Property Node(instance in=w17)
  $"coerced carrier frequency" <- w8
  $"coerced gain" <- w9
